% Requirement links of TestingScript.m (R2025b)

% line 5 verifies Requirements.slreqx#42
        function verifyWingUnfoldedSpan(testCase)

% line 10 verifies Requirements.slreqx#43
        function verifyWingFoldedSpan(testCase)

% line 14 verifies Requirements.slreqx#45
        function verifyAircraftHeight(testCase)

% line 18 verifies Requirements.slreqx#44
        function verifyAircraftLength(testCase)

% line 22 verifies Requirements.slreqx#8
        function verifyNumEngines(testCase)

% line 26 verifies Requirements.slreqx#36
        function verifyDesignLoadFactor(testCase)

% line 30 verifies Requirements.slreqx#25
        function verifyA2ACombatRadius(testCase)

% line 35 verifies Requirements.slreqx#31
        function verifyA2GCombatRadius(testCase)

% line 41 verifies Requirements.slreqx#18
        function verifyCMEA(testCase)

% line 48 verifies Requirements.slreqx#19
        function verifyLandingSpeed(testCase)